# Grasshopper definition SpecklePY Basics.gh (Grasshopper 1.0.8)
# plug-ins: RhinoCodePluginGH, Speckle 2

panel = Panel("https://macad.speckle.xyz/projects/f778fc7012/models/c17a9be343")
panel_2 = Panel("""1
2
4""")

# ---- group: Create a Base object
python_3_script = Python3Script()  # -> out, a
# ---------- python_3_script: Python ----------
from specklepy.objects.base import Base

speckleObject = Base()
speckleObject["myPythonProp"] = [[1,3,4,5,6],[2,6,89,0,56]]

a = speckleObject
# ---------- end python_3_script ----------

# ---- group: Create a Speckle Object (Serialized)
python_3_script_2 = Python3Script()  # -> out, a
# ---------- python_3_script_2: Python ----------
from specklepy.objects.base import Base
from specklepy.serialization.base_object_serializer import BaseObjectSerializer

# Create a Base object
speckleObject = Base()

# Add a property
speckleObject["myPythonProp"] = [[1,3,4,5,6],[2,6,89,0,56]]

# Serialize our base object
serializer = BaseObjectSerializer()
hash, serialized = serializer.write_json(speckleObject)

a = serialized
# ---------- end python_3_script_2 ----------

# ----
create_speckle_object = CreateSpeckleObject(A=panel_2, selectedKitName="Objects")
create_speckle_object_2 = CreateSpeckleObject(A=panel_2, selectedKitName="Objects")
panel_3 = Panel(python_3_script.a)
deserialize = Deserialize(Json=python_3_script_2.a)
panel_4 = Panel(deserialize)
receive = Receive(
    Stream=panel,
    AutoReceive=False,
    CurrentComponentState="up_to_date",
    ExpandOutput=False,
    LastInfoMessage="Joao Silva @ 02/14/2025 16:49:29:  (id:6c61490b3a)",
    ReceiveOnOpen=False,
    ReceivedCommitId="6c61490b3a",
    StreamWrapper="https://macad.speckle.xyz/projects/f778fc7012/models/added_prop",
    selectedKitName="Objects")  # -> Info, Data

# ---- group: Get an object property
python_3_script_3 = Python3Script(speckleObject=create_speckle_object)  # -> out, a, b
# ---------- python_3_script_3: Python ----------
from specklepy.objects.base import Base
import ghpythonlib.treehelpers as th


a = th.list_to_tree(speckleObject["@A"])


#b = speckleObject.get_member_names()
# ---------- end python_3_script_3 ----------

# ----
deconstruct_speckle_object = DeconstructSpeckleObject(SpeckleObject=deserialize, selectedKitName="Objects")  # -> MyPythonProp, Units

# ---- group: Print object properties
python_3_script_4 = Python3Script(speckleObject=python_3_script.a)  # -> out, b
# ---------- python_3_script_4: Python ----------
from specklepy.objects.base import Base
import ghpythonlib.treehelpers as th


b = speckleObject.get_member_names()
# ---------- end python_3_script_4 ----------

# ----
python_3_script_5 = Python3Script(speckleObject=receive.Data)  # -> out, a
# ---------- python_3_script_5: Python ----------
from specklepy.objects.base import Base
import ghpythonlib.treehelpers as th

a = speckleObject["MyProp"]

#b = speckleObject.get_member_names()
# ---------- end python_3_script_5 ----------
panel_5 = Panel(python_3_script_3.a)
panel_6 = Panel(python_3_script_4.b)
panel_7 = Panel(python_3_script_5.a)
